# Grasshopper definition RhinoPlugInV1.gh (Grasshopper 1.0.8)

py3 = Python3Script(x="35 Connecticut Avenue Five Dock 2046", y=Toggle(True))  # -> out, c, b, a
# ---------- py3: Python ----------
import Rhino.Geometry as rg
import math, json

try:
    from urllib.request import urlopen, Request
    from urllib.error import URLError, HTTPError
except ImportError:
    from urllib2 import urlopen, Request, URLError, HTTPError

# x = address (string)
# y = run (True/False toggle)
# z = check_mode (True/False toggle, leave False for now)
# u = proposed_height (number slider, default 8.5)

address         = x if x is not None else ""
run             = y if y is not None else False
check_mode      = z if z is not None else False
proposed_height = u if u is not None else 8.5
proposed_storeys = 2

lot_curve = envelope_crv = mass = None
citations = compliance_txt = ""
passed = None

BACKEND = "http://localhost:8000"

def post_json(endpoint, payload):
    body = json.dumps(payload).encode("utf-8")
    req  = Request(BACKEND + endpoint, data=body,
                   headers={"Content-Type": "application/json"})
    return json.loads(urlopen(req, timeout=20).read().decode("utf-8"))

def geojson_to_curve(geo, o_lng, o_lat):
    cos_lat = math.cos(math.radians(o_lat))
    def to_pt(lng, lat):
        return rg.Point3d((lng - o_lng) * 111320.0 * cos_lat,
                          (lat - o_lat) * 110540.0, 0.0)
    ring = geo["coordinates"][0]
    pts  = [to_pt(c[0], c[1]) for c in ring]
    pts.append(pts[0])
    return rg.Polyline(pts).ToNurbsCurve()

def get_max_height(rules_applied):
    for r in rules_applied:
        if (r.get("parameter") == "max_height"
                and r.get("operator") == "max"
                and not r.get("conditions")):
            return float(r["value"])
    vals = [float(r["value"]) for r in rules_applied
            if r.get("parameter") == "max_height"
            and r.get("operator") == "max"]
    return max(vals) if vals else 8.5

def format_citations(rules_applied):
    lines = ["Canada Bay DCP  -  Zone R2", "=" * 40, ""]
    seen  = set()
    for r in rules_applied:
        key = (r.get("parameter", ""), r.get("clause", ""))
        if key in seen:
            continue
        seen.add(key)
        op_str = {"min": ">=", "max": "<=", "eq": "="}.get(r.get("operator", ""), "")
        lines.append("[{}]  {}".format(
            r.get("clause", "?"),
            r.get("parameter", "?").replace("_", " ").title()))
        lines.append("  Rule : {} {} {}".format(
            op_str, r.get("value", ""), r.get("unit", "")))
        if r.get("text"):
            lines.append("  Text : \"{}\"".format(r["text"][:80]))
        if r.get("conditions"):
            lines.append("  Cond : {}".format("; ".join(r["conditions"][:2])))
        lines.append("")
    return "\n".join(lines)

if not run or not address:
    citations = "Wire a Panel to x (address) and a Toggle to y (run), then set run = True."
else:
    try:
        data          = post_json("/envelope", {"address": address})
        lot_geo       = data["lot_polygon"]
        env_geo       = data["envelope"]
        rules_applied = data["rules_applied"]
        max_h         = get_max_height(rules_applied)

        origin       = env_geo["coordinates"][0][0]
        o_lng, o_lat = origin[0], origin[1]

        lot_curve    = geojson_to_curve(lot_geo, o_lng, o_lat)
        env_curve    = geojson_to_curve(env_geo, o_lng, o_lat)
        envelope_crv = env_curve

        extrusion = rg.Extrusion.Create(env_curve, max_h, True)
        if extrusion:
            mass = extrusion.ToBrep()
        else:
            top = env_curve.Duplicate()
            top.Translate(rg.Vector3d(0, 0, max_h))
            breps = rg.Brep.CreateFromLoft(
                [env_curve, top],
                rg.Point3d.Unset, rg.Point3d.Unset,
                rg.LoftType.Normal, False)
            mass = breps[0] if breps else None

        citations = "Zone: {}  |  Max height: {}m  |  {} rules\n\n".format(
            data.get("zone", "R2"), max_h, len(rules_applied))
        citations += format_citations(rules_applied)

        print("Done - {}m height, {} rules applied".format(max_h, len(rules_applied)))

    except HTTPError as e:
        citations = "HTTP Error {}: {}".format(e.code, e.read().decode()[:200])
    except URLError:
        citations = "Cannot connect to backend.\nMake sure uvicorn is running:\n  python backend/run_apis.py"
    except Exception as e:
        import traceback
        citations = str(e) + "\n" + traceback.format_exc()

a = citations
b = mass
c = lot_curve
# ---------- end py3 ----------
panel = Panel(py3.a)
